% Simulink data dictionary Base_parameters.sldd

D_ref = 0.113
MOI_final = [0.038876733 -0.000384646 0.0023052; -0.000384646 5.121620512 3.47e-06; 0.0023052 3.47e-06 5.123025382]
MOI_final_raw = [38876.733 -384.646 2305.2; -384.646 5121620.512 3.47; 2305.2 3.47 5123025.382]
MOI_initial = [0.03986302 -0.000383345 0.002309809; -0.000383345 5.131347 3.468e-06; 0.002309809 3.468e-06 5.132752234]
MOI_initial_raw = [39863.025 -383.345 2309.809; -383.345 5131347.368 3.468; 2309.809 3.468 5132752.234]
S_ref = 0.01002875
Thrust = 0
escape_altitude = [0; 4.924039; 0]
initial_launch_angle = [0; 0; 1.396263; 0; 0]
launch_angle = [0; 80; 0]
m_dot_negative = 0
mass_final = 11.697
mass_fuel = 1.303
mass_initial = 13
latitude_initial = 40.138633
logitutde_initial = 139.98485